# Grasshopper definition main_samplingimagefile02.gh (Grasshopper 1.0.7)
# Copyright: Copyright to Ardaena
# Copyright: © 2017-2018 Pierre Cuvilliers, Caitlin Mueller, Massachusetts Institute of Technology
# plug-ins: Weaverbird

panel = Panel("D:\sem 3\0 python\GENERATIVEX_MEHDI\CourseFiles\06_Generative_WorkshopVer\Samples4Test\my_selectio\04TheVeins.jpg")
panel_2 = Panel("F:\Academy\MyCourses\Generative X\CourseFiles\06_Generative\Samples4Test\Selected")
panel_3 = Panel("D:\sem 3\0 python\GENERATIVEX_MEHDI\CourseFiles\06_Generative_WorkshopVer\Samples4Test\my_selectio")
# F:\Academy\MyCourses\Pythonized Gh\The Project Pythonized Grasshopper\The Final Project\Modeling\CentralGirih_50x50_ed.jpg
panel_4 = Panel("""numpy
scipy
matplotlib
matplotlib.pyplot
PIL
cv2
pathlib
glob2""")
ghpython_script = GhPythonScript(ReadOpenCV=Toggle(True), path=panel, path2=panel_3, img_iterate=Slider(0, range=0..9))  # -> out, a, img, imgCode, imgCode_List, imgResize, Col_List, Data_Color_Code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; inputs ReadOpenCV: Boolean, img_iterate: Int32
# ---------- ghpython_script: Python ----------
__author__ = "Mahdi Soheyli"
__version__ = "2021.08.01"

import rhinoscriptsyntax as rs
import System as sys

#Importing DataTree Modules
from Grasshopper.Kernel.Data import GH_Path
from Grasshopper import DataTree

#Importing PythonPackages Modules
import scriptcontext as sc
cv2 = sc.sticky['cv2']
scipy = sc.sticky['scipy']
PIL = sc.sticky['PIL']
matplotlib = sc.sticky['matplotlib']
matplotlib.pyplot = sc.sticky['matplotlib.pyplot']
pathlib = sc.sticky['pathlib']
np = sc.sticky['numpy']
glob = sc.sticky['glob2']

#------test---------#

a = str(np.random.random((5,2)))


#-------Opening the Image via OpenCV-------#

#----Loading the adresses----#
img_folder = glob.glob(path2)
imgs_path = []
for item in img_folder:
    for j in glob.glob(item+"/*.jpg"):
        imgs_path.append(j)


#------Img Iteration List-----#
img_iList = []
for img in imgs_path:
    img_iList.append(cv2.imread(img, cv2.IMREAD_GRAYSCALE))

print "1st Image Dimension is:", img_iList[0].shape


img = cv2.imread(path, 0)
print "Image Dim is:", img.shape


#-------Reshaping the Imge with the Surface U & V-------#
#The width adn length should be adapted to the surface U and V

def Image_Loading(List, I, UCoef, VCoef):
    
    #Behind the Scene Params
    Width = int(List[I].shape[0] * UCoef)
    Length = int(List[I].shape[1] * VCoef)
    NewDim = (Width, Length)
    #Image Resizing
    imgResize = cv2.resize(List[I], NewDim, interpolation = cv2.INTER_AREA)
    #DATA_List checking
    DATA_List = []
    for i in range(int(Length/VCoef)):
        DATA_List.append(imgResize[i].tolist())
    #Color_List Generation
    Color_List = []
    for k in range(len(DATA_List)):
        for j in DATA_List[k]:
            Color_List.append(int(j))
    #Results
    return DATA_List, Color_List


def ListToTree(SelectedList):
    
    dataTree = DataTree[object]()
    for i in range(len(img_iList)):
        Col_List = Image_Loading(SelectedList, i, 1, 1)[1]
        for j in range(len(Col_List)):
            path = GH_Path(i)
            dataTree.Add(Col_List[j], path)
    return dataTree, Col_List


if ReadOpenCV:
    DT = ListToTree(img_iList)[0]



"""
if ReadOpenCV:
    
    DT = DataTree[object]()
    All_Colors = []
    for i in range(len(img_iList)):
        Col_List = Image_Loading(img_iList, i, 1, 1)[1]
        for j in range(len(Col_List)):
            path = GH_Path(i)
            DT.Add(Col_List[j], path)
"""


#            All_Colors.insert(i, DT.Branch(path)[j])


#d = ListToTree(Image_Loading(img_iList, 1, 1, 1)[1])


"""

Width = int(img_iList[img_iterate].shape[0] * 1)
Length = int(img_iList[img_iterate].shape[1] * 1)
NewDim = (Width, Length)

imgResize = cv2.resize(img_iList[img_iterate], NewDim, interpolation = cv2.INTER_AREA)

print "Image Dim is:", imgResize.shape
b = str([i for i in imgResize])
c = imgResize[0].tolist()

Data_Color_Code = []
for i in range(Length):
    Data_Color_Code.append(imgResize[i].tolist())


Col_List = []
if ReadOpenCV:
    
    for i in range(len(Data_Color_Code)):
        for j in Data_Color_Code[i]:
            Col_List.append(int(j))

"""


"""
cv2.imshow("Resized", imgResize)
cv2.waitKey(0)
cv2.destroyAllWindows()
"""



"""

Data_Color_Code = []
for i in range(Length):
    Data_Color_Code.append(imgResize[i])

Col_List = []
for i in range(len(Data_Color_Code)):
    for j in Data_Color_Code[i]:
        Col_List.append(int(j))

"""
# ---------- end ghpython_script ----------
param_viewer = ParamViewer(ghpython_script.DT)
param_viewer_2 = ParamViewer(ghpython_script.DT)
gh_python_remote = GHPythonRemote(location="C:\Users\MD SAQLAIN KHAN\anaconda3\envs\rhinoremote", run=Toggle(True), modules=panel_4)  # -> out, linked_modules, rpy, import_statements
surface = Surface(<surface referenced from the Rhino model>)
ghpython_script_2 = GhPythonScript(path=panel)  # -> out, Data, Data_Code, a
# ---------- ghpython_script_2: Python ----------
__author__ = "Mahdi Soheyli"
__version__ = "2020.03.30"


import os
import ghpythonremote
from ghpythonlib.treehelpers import list_to_tree
import rhinoscriptsyntax as rs
import scriptcontext as sc
np = sc.sticky['numpy']
mpl = sc.sticky['matplotlib']
plt = mpl.pyplot
pil = sc.sticky['PIL']
cv2 = sc.sticky['cv2']

a = str(np.random.random((5,2)))

#path = 'F:\Academy\MyCourses\Pythonized Gh\The Project Pythonized Grasshopper\The Final Project\Modeling\Girih_Define25x25.jpg'
Data = []
img = np.asarray(pil.Image.open(path))

print (img[0,0,1])

for i in range(25):
    for j in range(25):
        Data.append(str(img[i, j, 0]))
        
#print Data

Data_Code = Data[0]
# ---------- end ghpython_script_2 ----------
number_slider = Slider(50, range=0..100)
panel_5 = Panel(ghpython_script.Col_List)
panel_6 = Panel(gh_python_remote.linked_modules)
panel_7 = Panel(gh_python_remote.import_statements)
panel_8 = Panel(ghpython_script.out)
panel_9 = Panel(ghpython_script.All_Colors)
panel_10 = Panel(ghpython_script.DT)
panel_12 = Panel(ghpython_script.imgs_path)
panel_13 = Panel(ghpython_script_2.out)
panel_14 = Panel(ghpython_script_2.a)
number_slider_2 = Slider(25, range=0..25)
tree_branch = TreeBranch(Tree=ghpython_script.DT, Path=Slider(4, range=0..9), MaintainPaths=True)
data = Data(tree_branch)
ghpython_script_3 = GhPythonScript(
    Srf=surface,
    U=number_slider,
    V=number_slider,
    Data=data,
    Domain_Start=Slider(0, range=0..100),
    Domain_End=Slider(1, range=0..1),
    Selection_Telorence=Slider(0.48, range=0..1))  # -> out, Subd_Srfs, U, V, Colours, Center_pt, New_Values, IEn, Selected_Pts; inputs Srf: Surface, U: Int32, V: Int32, Data: list of Int32, Domain_Start: Int32, Domain_End: Int32
# ---------- ghpython_script_3: Python ----------
__author__ = "Mahdi Soheyli"
__version__ = "2020.04.03"

import rhinoscriptsyntax as rs
import Rhino.Geometry as rg


#---------------SunDivision-------------#

Domain = rg.Interval(0, 10)

U_ = []
V_ =[]

Subd_Srfs = []

C1 = 10/U
C2 = 10/V

for i in range(0, U, 1):
    U_int = rg.Interval(i*(10/U), C1)
    
    C1 += 10/U
    U_.append(U_int)

for j in range(0, V, 1):
    V_int = rg.Interval(j*(10/V), C2)
    C2 += 10/V
    V_.append(V_int)

for i in range(len(U_)):
    for j in range(len(V_)):
        Subd_Srfs.append(rg.Surface.Trim(Srf, U_[i], V_[j]))

#---------------Colouring-------------#

Colours = []
for i in Data:
    Colour_ID = rs.CreateColor(i, i, i)
    Colours.append(Colour_ID)


#---------------Point@-------------#


Domain = rg.Interval(0, 1)

for i in Subd_Srfs:
    rg.Surface.SetDomain(i, 0, Domain)
    rg.Surface.SetDomain(i, 1, Domain)

Center_pt = []

for i in range(len(Subd_Srfs)):
    Center_pt.append(rg.Surface.PointAt(Subd_Srfs[i], 0.5, 0.5))


#---------------Remaping-------------#

Data_Range = max(Data) - min(Data)
#print Data_Range
New_Range = Domain_End - Domain_Start

New_Values = []
for i in Data:
    Val = ((i - min(Data))/Data_Range) + Domain_Start
    New_Values.append(Val)

#---------------SubSelection-------------#

IEn = [i for i, item in enumerate(New_Values) if item < Selection_Telorence]

Selected_Pts = []

for i in IEn:
    Selected_Pts.append(Center_pt[i])
# ---------- end ghpython_script_3 ----------
panel_15 = Panel(tree_branch)
panel_16 = Panel(ghpython_script_3.U)
custom_preview = CustomPreview(Geometry=ghpython_script_3.Subd_Srfs, Material=ghpython_script_3.Colours)
panel_17 = Panel(ghpython_script_3.IEn)
panel_18 = Panel(ghpython_script_3.V)
point = Point(ghpython_script_3.Center_pt)
point_2 = Point(ghpython_script_3.Selected_Pts)
panel_19 = Panel(ghpython_script_3.Colours)
panel_20 = Panel(ghpython_script_3.New_Values)
ghpython_script_4 = GhPythonScript(pt=point_2, Telorence=Slider(0.79, range=0.2..0.9))  # -> out, meshXL, MeshEdge, FinalEdges; inputs pt: list of Point3d
# ---------- ghpython_script_4: Python ----------
__author__ = "Mahdi Soheyli"
__version__ = "2020.04.01"

import rhinoscriptsyntax as rs
import Rhino.Geometry as rg
import ghpythonlib.components as ghcomp


#pl = rg.Plane.FitPlaneToPoints(pt)
meshXL = rg.Mesh.CreateFromTessellation(pt, None, rg.Plane.WorldXY, False)



topo = meshXL.TopologyEdges
MeshEdge = []
for i in range(topo.Count):
    MeshEdge.append(topo.EdgeLine(i))

FinalEdges = []

for item in MeshEdge:
    if item.Length < Telorence:
        FinalEdges.append(item)
# ---------- end ghpython_script_4 ----------
curve = Curve(ghpython_script_4.MeshEdge)
curve_2 = Curve(ghpython_script_4.FinalEdges)
mesh = Mesh(ghpython_script_4.meshXL)
ghpython_script_5 = GhPythonScript(
    Lines=curve_2,
    Meshing_Tolerence=Slider(0, range=0..1),
    Face_Valence=Slider(4, range=3..5),
    Dist=Slider(0.4, range=0..2),
    SmoothFactor=Slider(0.63, range=0..2))  # -> out, mesh, mesh_Uni; inputs Lines: list of Curve, Face_Valence: Int32
# ---------- ghpython_script_5: Python ----------
__author__ = "Mahdi Soheyli"
__version__ = "2020.04.01"

import rhinoscriptsyntax as rs
import Rhino.Geometry as rg
from System import Array

arr_lines = Array[rg.Curve](Lines)
#print arr_lines
mesh = rg.Mesh.CreateFromLines(arr_lines, Face_Valence, Meshing_Tolerence)

mesh_Uni = rg.Mesh.Offset(mesh, Dist, True)
rg.Mesh.Smooth(mesh_Uni, SmoothFactor, True, True, True, False, 0)
# ---------- end ghpython_script_5 ----------
mesh_2 = Mesh(ghpython_script_5.mesh_Uni)
weaverbird_s_loop_subdivision = WeaverbirdsLoopSubdivision(MeshCurves=mesh_2, Level=Slider(2, range=0..10), SmoothNakedEdges=1)
galapagos = Galapagos()
wbframe = WeaverbirdsPictureFrame(MeshPolylines=weaverbird_s_loop_subdivision, Distance=Slider(6, range=0..10), InsetType=0)
custom_preview_2 = CustomPreview(Geometry=wbframe, Material=ColourSwatch(SwatchColor=RGB(199, 0, 73)))

# ==== cluster GHPythonRemote: Connects the Grasshopper Python component to an external Python instance.
python = PythonScript()  # -> gh_parent_doc_dir
# ---------- python: Python ----------
from os import path

gh_parent_doc_dir = path.abspath(path.dirname(ghenv.Component.OnPingDocument().Owner.OnPingDocument().FilePath))
# ---------- end python ----------
# GH to python remote example.
# Pierre Cuvilliers, 2017-2018
# Released under the MIT license
# github.com/pilcru/ghpythonremote
# Runs and connects to an external python engine, and
# assigns imported modules to scriptcontext.sticky variables.
# 
# Arguments:
#       code (str): Path to the GH_to_python_sticky.py code file.
#       location (str): Path to a python executable, or to a folder
#             containing `python.exe`, or the name of a conda-created
#             virtual environment prefixed by `conda://` (`conda://env_name`).
#             If empty, finds python from your windows %PATH%.
#       run (boolean): Creates the connection, and imports new
#             modules, when turned to True. Kills the connection,
#             and deletes the references to the imports, when turned
#             to False.
#       modules (str list): List of module names to import in the
#             remote python. They will be added to the
#             scriptcontext.sticky dictionary, allowing them to be
#             reused from other python components in the same
#             Grasshopper document. Submodules (for example
#             `numpy.linalg` have to be added explicitly to this list
#             to be available later.
#       log_level (str from ['NOTSET', 'DEBUG', 'INFO', 'WARNING', 'ERROR', 'CRITICAL']):
#             Logging level to use for the local IronPython and the
#             remote python instance.
#       working_dir (str): Working directory for the remote python
#             instance.
# 
# Returns:
#       out (str): Console output with DEBUG information.
#       linked_modules (str list): list of imported module names.
#       rpy (rpyc connection object): The object representing the
#             remote Python interpreter.
location = ClusterInput()  # location (str): Path to a python executable, or to a folder containing `python.exe`, or the name of a conda-created virtual environment prefixed by `conda://` (`conda://env_name`). If empty, finds python from your windows %PATH%.
run = ClusterInput()  # run (boolean): Creates the connection, and imports new modules, when turned to True. Kills the connection,and deletes the references to the imports, when turned to False.
modules = ClusterInput()  # modules (str list): List of module names to import in the remote python. They will be added to the scriptcontext.sticky dictionary, allowing them to be reused from other python components in the same Grasshopper document. Submodules (for example `numpy.linalg` have to be added explicitly to this list to be available later.
list = ValueList({"CRITICAL", "ERROR", "WARNING", "INFO", "DEBUG", "NOTSET"}, selected="DEBUG")
panel = Panel(python)
ghpythonremote = GHPythonRemote(location=location, run=run, modules=modules, log_level=list, working_dir=panel)  # -> out, linked_modules, rpy; inputs run: Boolean, modules: list
# ---------- ghpythonremote: Python ----------
import inspect
import logging
from os import path
import sys
from time import sleep

import scriptcontext

import ghpythonremote
from ghpythonremote.connectors import GrasshopperToPythonRemote

local_log_level = getattr(logging, log_level, logging.WARNING)
logger = logging.getLogger("ghpythonremote")
logger.setLevel(local_log_level)
ch = logging.StreamHandler()
ch.setLevel(local_log_level)
formatter = logging.Formatter("%(levelname)s: %(name)s:\n%(message)s")
ch.setFormatter(formatter)
logger.handlers = []
logger.addHandler(ch)
logger = logging.getLogger("ghpythonremote.GH_to_python")

ROOT = path.abspath(path.dirname(inspect.getfile(ghpythonremote)))
rpyc_server_py = path.join(ROOT, "pythonservice.py")

# Set connection to CLOSED if this is the first run
# and initialize set of linked modules
try:
    remote_python_status
except NameError:
    remote_python_status = "CLOSED"
    lkd_modules = set()

# Wait for connection to connect or terminate
timer = 0
while remote_python_status == "CONNECTING" or remote_python_status == "CLOSING":
    sleep(1)
    timer += 1
    if timer == 10:
        try:
            gh2py_manager.__exit__(*sys.exc_info())
        except Exception:
            pass
        remote_python_status = "CLOSED"
        lkd_modules = set()
        raise RuntimeError(
            "Connection left in an inconsistent state and not returning. Reset "
            "everything."
        )

if run:
    if not remote_python_status == "OPEN":
        remote_python_status = "CONNECTING"
        gh2py_manager = GrasshopperToPythonRemote(
            rpyc_server_py,
            location=location,
            timeout=10,
            port=None,
            log_level=log_level,
            working_dir=working_dir,
        )
        gh2py = gh2py_manager.__enter__()
        remote_python_status = "OPEN"

    # Stuff that we can reach
    rpymod = gh2py.py_remote_modules  # A getter function for a named python module
    rpy = gh2py.connection  # Represents the remote instance root object
    scriptcontext.sticky["rpy"] = rpy
    # Add modules
    for mod in modules:
        try:
            scriptcontext.sticky[mod] = rpymod(mod)
            lkd_modules.add(mod)
        except ImportError:
            gh2py_manager.__exit__(*sys.exc_info())
            raise

elif not remote_python_status == "CLOSED":
    remote_python_status = "CLOSING"
    # Remove linked modules
    for mod in lkd_modules:
        del scriptcontext.sticky[mod]
    del scriptcontext.sticky["rpy"]
    gh2py_manager.__exit__(*sys.exc_info())
    lkd_modules = set()
    remote_python_status = "CLOSED"

# Change variable name because ghpython resets outputs to None before each run
linked_modules = lkd_modules

logger.info("GH to python connection is {}".format(remote_python_status))
# ---------- end ghpythonremote ----------
out = ClusterOutput(ghpythonremote.out)  # Console output.
linked_modules = ClusterOutput(ghpythonremote.linked_modules)  # Names of modules that were successfully added to the scriptcontext.sticky dictionary.
rpy = ClusterOutput(ghpythonremote.rpy)  # The object representing the remote python instance
python_2 = PythonScript(module_names=ghpythonremote.linked_modules)  # -> import_statements; inputs module_names: list
# ---------- python_2: Python ----------
import_statements = ["import scriptcontext as sc"]
for module_name in module_names:
    import_statements.append("{0} = sc.sticky['{0}']".format(module_name))

if len(module_names) == 0:
    import_statements = []
# ---------- end python_2 ----------
import_statements = ClusterOutput(python_2)  # Useful import statements to use the imported modules in your scripts.
